# Grasshopper definition Damped sine wave.gh (Grasshopper 1.0.4)
# plug-ins: Python Interpreter

number_slider = Slider(15.594, range=0..25)
pt = Point(<point referenced from the Rhino model>)
panel = Panel("y(t)=e^{-t} * cos (pi*t)")
X = UnitX(Factor=Slider(203, range=0..1000))
move = Move(Geometry=pt, Motion=X)  # -> Geometry, Transform
ln = Line(StartPoint=move.Geometry, EndPoint=pt)
divide = DivideCurve(Curve=ln, Count=number_slider, Kinks=False)  # -> Points, Tangents, Parameters
int = Integer(number_slider)
panel_2 = Panel(divide.Points)
python = PythonScript(x=int)  # -> out, a
# ---------- python: Python ----------
__author__ = "leondo"

import rhinoscriptsyntax as rs

for i in range(0, x+1):
    print i
# ---------- end python ----------
panel_3 = Panel(python.out)
item = ListItem(List=panel_2, Index=panel_3, Wrap=True)
panel_4 = Panel(item)
pdecon = Deconstruct(Point=panel_4)  # -> XComponent, YComponent, ZComponent
panel_5 = Panel(pdecon.XComponent)
pi = Pi(Factor=Slider(4, range=0..10))
multiplication = Multiplication(A=panel_5, B=pi)
multiplication_2 = Multiplication(A=panel_5, B=Slider(0.01871, range=0..1))
cos = Cosine(Value=multiplication)
eº = PowerOfE(Value=multiplication_2)
multiplication_3 = Multiplication(A=eº, B=cos)
panel_6 = Panel(multiplication_3)
xz = XZPlane(Origin=Point(0, 0, 0))
rev = ReverseList(List=panel_6)
Y = UnitY(Factor=rev)
move_2 = Move(Geometry=item, Motion=Y)  # -> Geometry, Transform
nurbs = NurbsCurve(Vertices=move_2.Geometry, Degree=3, Periodic=False)  # -> Curve, Length, Domain
x_tremez = Extremes(Curve=nurbs.Curve, Plane=xz)  # -> Highest, Lowest
pt_2 = Point(x_tremez.Highest)
pt_3 = Point(x_tremez.Lowest)
cp = ClosestPoint(Point=pt, Cloud=[pt_3, pt_2])  # -> ClosestPoint, CPIndex, Distance
pdecon_2 = Deconstruct(Point=cp.ClosestPoint)  # -> XComponent, YComponent, ZComponent
neg = Negative(Value=pdecon_2.XComponent)
X_2 = UnitX(Factor=neg)
move_3 = Move(Geometry=nurbs.Curve, Motion=X_2)  # -> Geometry, Transform
move_4 = Move(Geometry=cp.ClosestPoint, Motion=X_2)  # -> Geometry, Transform
number_slider_2 = Slider(270, range=0..360)
rad = Radians(Degrees=number_slider_2)
yz = YZPlane(Origin=Point(0, 0, 0))
rotate = Rotate(Geometry=move_3.Geometry, Angle=rad, Plane=yz)  # -> Geometry, Transform
rad_2 = Radians(Degrees=number_slider_2)
yz_2 = YZPlane(Origin=Point(0, 0, 0))
rotate_2 = Rotate(Geometry=move_4.Geometry, Angle=rad_2, Plane=yz_2)  # -> Geometry, Transform
circle = CircleCNR(Center=rotate_2.Geometry, Normal=Vector(0, 0, 1), Radius=Slider(0.021914, range=0..1))
swp1 = Sweep1(Rail=circle, Sections=rotate.Geometry, Miter=1)
